# Grasshopper definition git_robot.gh (Grasshopper 1.0.7)
# plug-ins: Triceratops, Githopper

pt = ConstructPoint(XCoordinate=0, YCoordinate=0, ZCoordinate=0)
number_slider = Slider(8, range=0..10)
number_slider_2 = Slider(1, range=0..1)

# ---- group: Robot Controls
number_slider_3 = Slider(1.4, range=0..2)
number_slider_4 = Slider(0.3, range=-0.5..0.5)

# ----
number_slider_5 = Slider(0.7, range=0..1)
cyl = Cylinder(Base=pt, Radius=number_slider, Length=number_slider_2)
addition = Addition(A=number_slider_2, B=Slider(0.522, range=0..1))
cap = CapHoles(Brep=cyl)
Z = UnitZ(Factor=addition)
scale_nu = ScaleNU(Geometry=cap, Plane=pt, ScaleX=number_slider_5, ScaleY=number_slider_5, ScaleZ=Slider(3, range=0..10))  # -> Geometry, Transform
line = LineSDL(Start=pt, Direction=Z, Length=1)

username = Panel("l00sed")
email = Panel("danielwtompkins@gmail.com")
git_commit = Button()
# # README
# 
# 1. Before getting started, create an account at [food4rhino.com](https://food4rhino.com) and download the latest version of [GitHopper](https://www.food4rhino.com/app/githopper).
# 
# 2. Move the grasshopper python script to `C:/Users/USERNAME/AppData/Roaming/Grasshopper/Libraries`
# 
# 3. You may need to right-click on the file, select properties, and check the "Unblock" toggle.
# 
# ## Getting Started
# 
# 1. Add a new panel with your 'Username' and 'Email' to link to your GitHub account.
# 
# 2. Double-click the boolean toggle ("Initialize") to allow GitHopper to recognize the existence of the repo.
# 
# 	- The "Status" panel should now read: `The git repository initialized successfully`
# 
# 3. Drag the number slider to choose from the available branches.
# 
# 4. You can click the 'git pull' button to download the latest files / grasshopper script to your local machine. However, I recommend using an actual terminal to pull before opening Rhino at all.
# 
# ## Pushing to Remote
# 
# 1. After making changes, *SAVE* your grasshopper file.
# 
# 2. Click the 'git add' button to add your updated files
# 
# 3. Click the 'git commit' button to commit your changes with the optional "Commit Message" text (you can change this in the panel, default is "updated").
# 
# 4. Click the 'git push' button to push to the remote repo. You should receive a pop-up to put in your GitHub credentials. If the pop-up closes without any additional dialog, you might want to try again (you probably didn't enter your password correctly).
initialize = BooleanToggle(True)
git_push = Button()
git_add = Button()
git_pull = Button()  # disabled
select_branch = SelectBranch(Index=Slider(1, range=0..3))  # -> Branch, Branches
commit_message = Panel("updated")
branch = Panel(select_branch.Branch)
panel = Panel("git pull origin ")  # disabled
nickname = RelativePath()
path = GitPath(Path=nickname, Create_path=initialize, Set=initialize)  # -> Report, Help
create_git = CreateGitRepository(User_name=username, User_email=email, Initialize=initialize)  # -> Report, Help
concat = Concatenate(FragmentA=commit_message, FragmentB="\" & exit")
concat_2 = Concatenate(FragmentA=branch, FragmentB=" & exit")
concat_3 = Concatenate(FragmentA="git commit -m \"", FragmentB=concat)
concat_4 = Concatenate(FragmentA="git push origin ", FragmentB=concat_2)
concat_5 = Concatenate(FragmentA=panel, FragmentB=concat_2)  # disabled
panel_2 = Panel(path.Report)
status = Panel(create_git.Report)
execute = ExecuteGitCommand(Command="git add -A & exit", Execute=git_add)
execute_2 = ExecuteGitCommand(Command=concat_3, Execute=git_commit)
execute_3 = ExecuteGitCommand(Command=concat_4, Execute=git_push)
execute_4 = ExecuteGitCommand(Command=concat_5, Execute=git_pull)  # disabled

move = Move(Geometry=cap, Motion=Z)  # -> Geometry, Transform
move_2 = Move(Geometry=scale_nu.Geometry, Motion=Z)  # -> Geometry, Transform
debrep = DeconstructBrep(Brep=move_2.Geometry)  # -> Faces, Edges, Vertices
debrep_2 = DeconstructBrep(Brep=move.Geometry)  # -> Faces, Edges, Vertices
pdecon = Deconstruct(Point=debrep.Vertices)  # -> XComponent, YComponent, ZComponent
pdecon_2 = Deconstruct(Point=debrep_2.Vertices)  # -> XComponent, YComponent, ZComponent
sort = SortList(Keys=pdecon.ZComponent, ValuesA=debrep.Vertices)  # -> Keys, ValuesA
sort_2 = SortList(Keys=pdecon_2.ZComponent, ValuesA=debrep_2.Vertices)  # -> Keys, ValuesA
rev = ReverseList(List=sort.ValuesA)
rev_2 = ReverseList(List=sort_2.ValuesA)
item = ListItem(List=rev, Index=0, Wrap=True)
item_2 = ListItem(List=rev_2, Index=0, Wrap=True)
ln = Line(StartPoint=item, EndPoint=item_2)
divide = DivideCurve(Curve=ln, Count=Slider(3, range=0..10), Kinks=False)  # -> Points, Tangents, Parameters
end = EndPoints(Curve=ln)  # -> Start, End
lng = ListLength(List=divide.Points)
expression = Expression(x=lng, Expression="x-1")
merge = Merge(Data1=expression, Data2=Slider(0, range=0..100))  # -> flatten(Result)
cull_i = CullIndex(List=divide.Points, Indices=merge, Wrap=True)
neg = Negative(Value=Slider(0, range=0..1))
Z_2 = UnitZ(Factor=neg)
move_3 = Move(Geometry=cull_i, Motion=Z_2)  # -> Geometry, Transform
merge_2 = Merge(Data1=end.Start, Data2=move_3.Geometry, Data3=end.End)  # -> flatten(Result)
pdecon_3 = Deconstruct(Point=merge_2)  # -> XComponent, YComponent, ZComponent
sort_3 = SortList(Keys=pdecon_3.ZComponent, ValuesA=merge_2)  # -> Keys, ValuesA
intcrv = Interpolate(Vertices=flatten(sort_3.ValuesA), Degree=3, Periodic=False, KnotStyle=1)  # -> Curve, Length, Domain
revsrf = Revolution(Curve=intcrv.Curve, Axis=line, Domain=Domain(0, 6.283185307))
cap_2 = CapHoles(Brep=revsrf)
join = BrepJoin(Breps=[move.Geometry, cap_2])  # -> Breps, Closed
mirror = Mirror(Geometry=join.Breps, Plane=item)  # -> Geometry, Transform
debrep_3 = DeconstructBrep(Brep=mirror.Geometry)  # -> flatten(Faces), flatten(Edges), Vertices
item_3 = ListItem(List=debrep_3.Faces, Index=0, Wrap=True)
item_4 = ListItem(List=debrep_3.Edges, Index=0, Wrap=True)
divide_2 = DivideCurve(Curve=item_4, Count=10, Kinks=False)  # -> Points, Tangents, Parameters
intcrv_2 = Interpolate(Vertices=divide_2.Points, Degree=1, Periodic=True, KnotStyle=1)  # -> Curve, Length, Domain
Z_3 = UnitZ(Factor=1)
pcen = PolygonCenter(Polyline=intcrv_2.Curve)  # -> CenterV, CenterE, CenterA
sph = Sphere(Base=pcen.CenterV, Radius=number_slider)
line_2 = LineSDL(Start=pcen.CenterV, Direction=Z_3, Length=Slider(44, range=0..100))
split = SplitBrep(Brep=sph, Cutter=item_3)
pipe = Pipe(Curve=line_2, Radius=Slider(8, range=0..10), Caps=2)
item_5 = ListItem(List=split, Index=0, Wrap=True)
pi = Pi(Factor=number_slider_4)
move_4 = Move(Geometry=pipe, Motion=Vector(0, 0, 15.66940616))  # -> Geometry, Transform
cap_3 = CapHoles(Brep=item_5)
xz = XZPlane(Origin=pcen.CenterV)
join_2 = BrepJoin(Breps=[cap_3, mirror.Geometry])  # -> Breps, Closed
rotate = Rotate(Geometry=move_4.Geometry, Angle=pi, Plane=xz)  # -> Geometry, Transform
pi_2 = Pi(Factor=number_slider_3)
group = Group(Objects=[join_2.Breps, rotate.Geometry])
rotate_2 = Rotate(Geometry=group, Angle=pi_2, Plane=PlaneXY(0, 0, 0))  # -> Geometry, Transform
