# Grasshopper definition palette_git_master.gh (Grasshopper 1.0.7)
# plug-ins: Triceratops, Githopper, Palette

mesh = Mesh(<mesh referenced from the Rhino model>)
mesh_2 = Mesh(<mesh referenced from the Rhino model>)
facen = FaceNormals(Mesh=mesh_2)  # -> Centers, Normals
demesh = DeconstructMesh(Mesh=mesh)  # -> Vertices, Faces, Colours, Normals
pdecon = Deconstruct(Point=facen.Centers)  # -> XComponent, YComponent, ZComponent
pdecon_2 = Deconstruct(Point=demesh.Vertices)  # -> XComponent, YComponent, ZComponent
addition = Addition(A=pdecon.XComponent, B=pdecon.YComponent)
addition_2 = Addition(A=pdecon_2.XComponent, B=pdecon_2.YComponent)

# ---- group: Palette
swatch = ColourSwatch(SwatchColor=RGBA(0, 255, 255, 0))
swatch_2 = ColourSwatch(SwatchColor=RGB(64, 70, 67))
swatch_3 = ColourSwatch(SwatchColor=RGBA(0, 0, 0, 28))
swatch_4 = ColourSwatch(SwatchColor=RGB(68, 255, 156))
swatch_5 = ColourSwatch(SwatchColor=RGB(255, 187, 156))
swatch_6 = ColourSwatch(SwatchColor=RGB(241, 111, 90))
swatch_7 = ColourSwatch(SwatchColor=RGBA(255, 0, 72, 179))
swatch_8 = ColourSwatch(SwatchColor=RGB(255, 0, 72))
swatch_9 = ColourSwatch(SwatchColor=RGB(40, 50, 50))
swatch_10 = ColourSwatch(SwatchColor=RGB(255, 255, 255))
swatch_11 = ColourSwatch(SwatchColor=RGB(255, 55, 72))
number_slider = Slider(15, range=0..100)
swatch_12 = ColourSwatch(SwatchColor=RGBA(255, 255, 255, 160))
palette = Palette(
    ModeCustomStandard=Toggle(True),
    Component_Normal_Deselected_Fill_Color=swatch_2,
    Component_Normal_Deselected_Edge_Color=swatch_3,
    Component_Normal_Deselected_Text_Color=swatch_12,
    Component_Normal_Selected_Fill_Color=swatch_4,
    Component_Normal_Selected_Edge_Color=swatch_3,
    Component_Normal_Selected_Text_Color=ColourSwatch(SwatchColor=RGB(0, 0, 0)),
    Component_Hidden_Deselected_Fill_Color=swatch_3,
    Component_Hidden_Deselected_Edge_Color=swatch_3,
    Component_Hidden_Deselected_Text_Color=swatch_12,
    Component_Hidden_Selected_Fill_Color=ColourSwatch(SwatchColor=RGBA(68, 255, 156, 137)),
    Component_Hidden_Selected_Edge_Color=swatch_3,
    Component_Hidden_Selected_Text_Color=ColourSwatch(SwatchColor=RGBA(0, 0, 0, 203)),
    Component_Disabled_Deselected_Fill_Color=swatch,
    Component_Disabled_Deselected_Edge_Color=swatch,
    Component_Disabled_Deselected_Text_Color=swatch_2,
    Component_Disabled_Selected_Fill_Color=RGB(110, 150, 115),
    Component_Disabled_Selected_Edge_Color=RGB(40, 70, 40),
    Component_Disabled_Selected_Text_Color=RGB(75, 100, 65),
    Component_Warning_Deselected_Fill_Color=swatch_5,
    Component_Warning_Deselected_Edge_Color=swatch_5,
    Component_Warning_Deselected_Text_Color=RGB(0, 0, 0),
    Component_Warning_Selected_Fill_Color=swatch_6,
    Component_Warning_Selected_Edge_Color=swatch_6,
    Component_Warning_Selected_Text_Color=RGB(0, 0, 0),
    Component_Error_Deselected_Fill_Color=swatch_7,
    Component_Error_Deselected_Edge_Color=swatch_7,
    Component_Error_Deselected_Text_Color=swatch_9,
    Component_Error_Selected_Fill_Color=swatch_8,
    Component_Error_Selected_Edge_Color=swatch_8,
    Component_Error_Selected_Text_Color=swatch_9,
    Component_Label_Deselected_Fill_Color=swatch_9,
    Component_Label_Deselected_Edge_Color=swatch_9,
    Component_Label_Deselected_Text_Color=swatch_10,
    Component_Label_Selected_Fill_Color=swatch_9,
    Component_Label_Selected_Edge_Color=swatch_9,
    Component_Label_Selected_Text_Color=swatch_10,
    Galapagos_Deselected_Fill_Color=swatch_11,
    Galapagos_Deselected_Edge_Color=swatch_3,
    Galapagos_Selected_Fill_Color=swatch_4,
    Galapagos_Selected_Edge_Color=swatch_3,
    Wire_Normal_Color=swatch_12,
    Wire_Empty_Color=swatch_3,
    Wire_Selected_Start_Color=swatch_4,
    Wire_Selected_End_Color=ColourSwatch(SwatchColor=RGB(0, 255, 255)),
    Panel_Default_Color=swatch_10,
    Group_Default_Color=swatch_11,
    Canvas_Background_Color=swatch_9,
    Canvas_Gridline_Color=ColourSwatch(SwatchColor=RGB(50, 60, 60)),
    Canvas_Gridline_Width=number_slider,
    Canvas_Gridline_Height=number_slider,
    Canvas_Edge_Color=swatch_11,
    Canvas_Shadow_Color=swatch_11,
    Canvas_Shadow_Size=Slider(100, range=0..100),
    MonochromaticOnOff=False,
    Monochromatic_Color=RGB(212, 208, 200))

# ----
sort = SortList(Keys=addition)  # -> Keys, ValuesA
sort_2 = SortList(Keys=addition_2)  # -> Keys, ValuesA
item = ListItem(List=reverse(sort.Keys), Index=0, Wrap=True)
item_2 = ListItem(List=sort.Keys, Index=0, Wrap=True)
item_3 = ListItem(List=reverse(sort_2.Keys), Index=0, Wrap=True)
item_4 = ListItem(List=sort_2.Keys, Index=0, Wrap=True)
gradient = Gradient(
    LowerLimit=item_2,
    UpperLimit=item,
    Parameter=addition,
    stops=[0: RGB(255, 61, 61), 0.509: RGB(255, 178, 84), 1: RGB(255, 244, 38)])
gradient_2 = Gradient(
    LowerLimit=item_4,
    UpperLimit=item_3,
    Parameter=addition_2,
    stops=[0: RGB(255, 61, 61), 0.509: RGB(255, 178, 84), 1: RGB(255, 244, 38)])
geo = Geometry(<curve referenced from the Rhino model>)
geo_2 = Geometry(<curve referenced from the Rhino model>)

# ----
# MeshBasicMaterial (wireframe)
number_slider_2 = Slider(10, range=0..10)
basicmat = MeshBasicMaterial(
    Color=ColourSwatch(SwatchColor=RGB(255, 132, 87)),
    Wireframe=Toggle(True),
    WireframeLineJoin="round",
    WireframeLineWidth=number_slider_2)  # -> JSON, Material
mesh_3 = Mesh(<mesh referenced from the Rhino model>)
mesh_4 = Mesh(Mesh=mesh_3, Name="meshBasicMaterial_wireframe", Material=basicmat.Material)  # -> JSON, Geometry

topoly = CurveToPolyline(Curve=geo, ToleranceDistance=0, ToleranceAngle=Slider(0.1, range=0..10))  # -> Polyline, Segments
topoly_2 = CurveToPolyline(Curve=geo_2, ToleranceDistance=0, ToleranceAngle=Slider(0.1, range=0..10))  # -> Polyline, Segments

# ----
# Scene Example
panel = Panel("houses")
mesh_5 = Mesh(<mesh referenced from the Rhino model>)
mesh_6 = Mesh(<mesh referenced from the Rhino model>)
meshstdrdmat = MeshStandardMaterial(C=ColourSwatch(SwatchColor=RGB(255, 255, 255)), O=1, R=1, M=0.5, Wl=1)  # -> JSON, Material
meshstdrdmat_2 = MeshStandardMaterial(C=ColourSwatch(SwatchColor=RGB(135, 255, 135)), O=1, R=1, M=0.5, Wl=1)  # -> JSON, Material
meshstdrdmat_3 = MeshStandardMaterial(C=ColourSwatch(SwatchColor=RGB(191, 191, 191)), O=1, R=1, M=0.5, Wl=1)  # -> JSON, Material
merge = Merge(Data1=mesh_6, Data2=mesh_5)
merge_2 = Merge(Data1=panel, Data2="buildings")
mesh_7 = Mesh(<mesh referenced from the Rhino model>)
mesh_8 = Mesh(<mesh referenced from the Rhino model>)
mesh_9 = Mesh(Mesh=merge, Name=merge_2, Material=meshstdrdmat.Material)  # -> JSON, Geometry
mesh_10 = Mesh(Mesh=mesh_7, Name="grass", Material=meshstdrdmat_2.Material)  # -> JSON, Geometry
mesh_11 = Mesh(Mesh=mesh_8, Name="street", Material=meshstdrdmat_3.Material)  # -> JSON, Geometry

# ----
# MeshStandardMaterial (metallic)
number_slider_3 = Slider(0.2, range=0..1)
meshstdrdmat_4 = MeshStandardMaterial(C=ColourSwatch(SwatchColor=RGB(255, 132, 87)), O=1, R=number_slider_3, M=Slider(0.5, range=0..1), Wl=1)  # -> JSON, Material
mesh_12 = Mesh(<mesh referenced from the Rhino model>)
mesh_13 = Mesh(Mesh=mesh_12, Name="meshStandardMaterial", Material=meshstdrdmat_4.Material)  # -> JSON, Geometry

# ----
# MeshStandardMaterial (emissive)
number_slider_4 = Slider(0.5, range=0..1)
meshstdrdmat_5 = MeshStandardMaterial(
    C=ColourSwatch(SwatchColor=RGB(255, 132, 87)),
    O=1,
    R=Slider(0.2, range=0..1),
    M=number_slider_4,
    E=ColourSwatch(SwatchColor=RGB(0, 183, 255)),
    W=Slider(0.6, range=0..1),
    Wl=1)  # -> JSON, Material
mesh_14 = Mesh(<mesh referenced from the Rhino model>)
mesh_15 = Mesh(Mesh=mesh_14, Name="meshStandardMaterial", Material=meshstdrdmat_5.Material)  # -> JSON, Geometry

# ----
# MeshVertexColors w/Faces Colored
# note: While it looks like this component is coloring the mesh faces directly, its actually unwelding the mesh edges and coloring the vertices surrounding each face.
# note: Both meshBasicMaterial and meshStandardMaterial components can be used with MeshVertexColors.
# 
# note: MeshVertexColors component overides any color set by the material component.
colorface = MeshColorFaces(Mesh=mesh_2, Color=gradient)
meshstdrdmat_6 = MeshStandardMaterial(C=RGB(100, 149, 237), O=1, R=1, M=0.5, Wl=1)  # -> JSON, Material
meshvertex = MeshVertexColors(Mesh=colorface, Name="mesh_face_colors", Material=meshstdrdmat_6.Material)  # -> JSON, Geometry

# ----
# MeshVertexColors
# note: Both meshBasicMaterial and meshStandardMaterial components can be used with MeshVertexColors.
# 
# note: MeshVertexColors component overides any color set by the material component.
mcol = MeshColours(Mesh=mesh, Colours=gradient_2)
meshstdrdmat_7 = MeshStandardMaterial(C=RGB(100, 149, 237), O=1, R=1, M=0.5, Wl=1)  # -> JSON, Material
meshvertex_2 = MeshVertexColors(Mesh=mcol, Name="mesh_vertex_colors", Material=meshstdrdmat_7.Material)  # -> JSON, Geometry

# ----
# MeshStandardMaterial
swatch_13 = ColourSwatch(SwatchColor=RGB(255, 132, 87))
meshstdrdmat_8 = MeshStandardMaterial(C=swatch_13, O=1, R=1, M=0.5, Wl=1)  # -> JSON, Material
mesh_16 = Mesh(<mesh referenced from the Rhino model>)
mesh_17 = Mesh(Mesh=mesh_16, Name="meshStandardMaterial", Material=meshstdrdmat_8.Material)  # -> JSON, Geometry

# ----
# MeshBasicMaterial
swatch_14 = ColourSwatch(SwatchColor=RGB(255, 132, 87))
basicmat_2 = MeshBasicMaterial(Color=swatch_14, Wireframe=False, WireframeLineJoin="round", WireframeLineWidth=1)  # -> JSON, Material
mesh_18 = Mesh(<mesh referenced from the Rhino model>)
mesh_19 = Mesh(Mesh=mesh_18, Name="meshBasicMaterial", Material=basicmat_2.Material)  # -> JSON, Geometry

# ----
# Annotations
swatch_15 = ColourSwatch(SwatchColor=RGB(150, 150, 150))
basicmat_3 = MeshBasicMaterial(Color=swatch_15, Wireframe=False, WireframeLineJoin="round", WireframeLineWidth=1)  # -> JSON, Material
mesh_20 = Mesh([<mesh referenced from the Rhino model> x15])
mesh_21 = Mesh(Mesh=mesh_20, Name="captions", Material=basicmat_3.Material)  # -> JSON, Geometry

# ----
# MeshNormalMaterial
panel_2 = Panel("meshNormalMaterial")
normalmat = MeshNormalMaterial(Wireframe=False, WireframeLineJoin="round", WireframeLineWidth=1)  # -> JSON, Material
mesh_22 = Mesh(<mesh referenced from the Rhino model>)
mesh_23 = Mesh(Mesh=mesh_22, Name=panel_2, Material=normalmat.Material)  # -> JSON, Geometry

# ----
# LineDashedMaterial
number_slider_5 = Slider(0.2, range=0..10)
linedashmat = LineDashedMaterial(
    Color=ColourSwatch(SwatchColor=RGB(77, 201, 255)),
    LineWidth=1,
    DashSize=number_slider_5,
    GapSize=Slider(0.2, range=0..10))  # -> JSON, LineMaterial
line = Line(Line=topoly.Polyline, LineMaterial=linedashmat.LineMaterial)  # -> JSON, Geometry

# ----
# LineDashedMaterial
number_slider_6 = Slider(0.2, range=0..10)
linedashmat_2 = LineDashedMaterial(
    Color=ColourSwatch(SwatchColor=RGB(77, 201, 255)),
    LineWidth=1,
    DashSize=number_slider_6,
    GapSize=Slider(0.2, range=0..10))  # -> JSON, LineMaterial
crv = Curve([<curve referenced from the Rhino model> x12])
line_2 = Line(Line=crv, LineMaterial=linedashmat_2.LineMaterial)  # -> JSON, Geometry

# ----
# LineBasicMaterial
swatch_16 = ColourSwatch(SwatchColor=RGB(77, 201, 255))
linebasicmat = LineBasicMaterial(Color=swatch_16, LineWidth=1)  # -> JSON, LineMaterial
line_3 = Line(Line=topoly_2.Polyline, LineMaterial=linebasicmat.LineMaterial)  # -> JSON, Geometry

# ----
# LineBasicMaterial
swatch_17 = ColourSwatch(SwatchColor=RGB(77, 201, 255))
linebasicmat_2 = LineBasicMaterial(Color=swatch_17, LineWidth=1)  # -> JSON, LineMaterial
crv_2 = Curve([<curve referenced from the Rhino model> x12])
line_4 = Line(Line=crv_2, LineMaterial=linebasicmat_2.LineMaterial)  # -> JSON, Geometry

# ----
# note: You can interpolate the colors on the vertices by welding the mesh edges.
weld = WeldMesh(Mesh=colorface, Angle=3.141592654)

# ----
# MeshNormalMaterial
mesh_24 = Mesh([<mesh referenced from the Rhino model> x2])
mesh_25 = Mesh(Mesh=mesh_24, Name="mesh")  # -> JSON, Geometry

# ----
# Line
crv_3 = Curve([<curve referenced from the Rhino model> x12])
line_5 = Line(Line=crv_3)  # -> JSON, Geometry

httpin = HttpInput(Start=Toggle(True), Prefix="http://localhost:8080/grasshopper/")  # -> Keys, Values, ListenerObject
nickname = RelativePath()

# ---- group: Github Integration
button = Button()
username = Panel("l00sed")
email = Panel("danielwtompkins@gmail.com")
toggle = BooleanToggle(True)
select_branch = SelectBranch(Index=Slider(0, range=0..100))  # -> Branch, Branches
execute = ExecuteGitCommand(Command="git commit -m \"updated\" & exit", Execute=Button())
execute_2 = ExecuteGitCommand(Command="git push origin master & exit", Execute=Button())
execute_3 = ExecuteGitCommand(Command="git add -A & exit", Execute=Button())
path = GitPath(Path=nickname, Create_path=toggle, Set=button)  # -> Report, Help
create_git = CreateGitRepository(User_name=username, User_email=email, Initialize=toggle)  # -> Report, Help
push = PushToRepository(Branch=select_branch.Branch, Repository="https://github.com/l00sed/grasshopper", Push=button)
panel_3 = Panel(push)
panel_4 = Panel(path.Report)
panel_5 = Panel(create_git.Report)

# ----
httpout = HttpOutput(HttpListener=httpin.ListenerObject)
merge_3 = Merge(
    Data1=mesh_25.Geometry,
    Data2=mesh_23.Geometry,
    Data3=mesh_19.Geometry,
    Data4=mesh_4.Geometry,
    Data5=mesh_17.Geometry,
    Data6=mesh_13.Geometry,
    Data7=mesh_15.Geometry,
    Data8=meshvertex_2.Geometry,
    Data9=meshvertex.Geometry,
    Data10=line_5.Geometry,
    Data11=line_4.Geometry,
    Data12=line_2.Geometry,
    Data13=line_3.Geometry,
    Data14=line.Geometry,
    Data15=mesh_9.Geometry,
    Data16=mesh_10.Geometry,
    Data17=mesh_11.Geometry,
    Data18=mesh_21.Geometry)  # -> flatten(Result)

# ----
# Compile Scene and Export
panel_6 = Panel("C:\Users\dtompkins\Documents\AGH\kiosk")
scene = CompileScene(Geometry=flatten(merge_3))  # -> JSON, Scene
json = ExportJSON(Path=panel_6, FileName="example_scene", Data=scene.Scene, Write=Toggle(True))
path_2 = FilePath(json)
